% Simulink data dictionary dictionary.sldd

freq = 314.1593
phase = 3.141593
phsw_marg = 0.1
ts = 0.0001
volts = 1.533412
fault = Simulink.Bus()
SharedConfig = Simulink.ConfigSet(StartTime="0", StopTime="1/5", FixedStep="ts", Solver="FixedStepAuto", ProdHWDeviceType="ARM Compatible->ARM Cortex-M", SystemTargetFile="ert.tlc", TargetLang="C")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